# Grasshopper definition example_gh3d.ghx (Grasshopper 0.9.76)
# plug-ins: Python Interpreter

series = Series(Start=0, Step=1, Count=Slider(54, range=0..100))
ganggang_client = PythonScript(Activate=Toggle(False), Host="localhost", Port="9998", Data=series)  # -> Result; inputs Port: Int32, Data: list
# ---------- ganggang_client: Python ----------
import GangGang

if (Activate):
    Result = GangGang.client(Host, Port, Data)
# ---------- end ganggang_client ----------
panel = Panel(series)
panel_2 = Panel(ganggang_client)
